# Grasshopper definition Async Test-Anemone.gh (Grasshopper 1.0.7)
# plug-ins: Anemone, Kangaroo2 Components

mplane = MeshPlane(Boundary={Plane=PlaneXY(0, 0, 0), Size=Domain2(u=-10..10, v=-10..10)}, WidthCount=10, HeightCount=10)  # -> Mesh, Area
nv = NakedVertices(Mesh=mplane.Mesh)  # -> ClothedIndex, NakedIndex, ClothedPts, NakedPts
edgelengths = EdgeLengths(Mesh=mplane.Mesh, LengthFactor=1, Strength=1)
loop_start = LoopStart(Repeat=Slider(8, range=0..10), Data=Slider(1, range=0..1))  # -> port, Counter, Data
anchor = Anchor(Point=nv.NakedPts, Strength=10000)
addition = Addition(A=loop_start.Counter, B=1)
load = Load(Point=nv.ClothedPts, ForceVector=Vector(0, 0, 1), Weighting=1)
multiplication = Multiplication(A=addition, B=loop_start.Data)
loop_end = LoopEnd(port=loop_start.port, Exit=False, Data=multiplication, TimeOutVal=0, pausedState=False, state="Constant & Record")
bouncysolver = BouncySolver(
    GoalObjects=[edgelengths, load, anchor],
    Reset=Button(),
    Threshold=1e-15,
    Tolerance=0.0001,
    Damping=0.99,
    Iterations=10,
    On=Toggle(False))  # -> I, V, O
panel = Panel(loop_end)
