# Grasshopper definition Async Test-Cluster.gh (Grasshopper 1.0.7)

cluster = Cluster(x=Slider(68, range=0..100))
panel = Panel(cluster)

# ==== cluster Cluster
x = ClusterInput()
fifth = CSharpScript(x=x)  # -> A; inputs x: Int32
# ---------- fifth: C# usings ----------
using System.Threading;
# ---------- fifth: C# ----------
    Thread.Sleep(5000);
    A = x + 1;
# ---------- end fifth ----------
A = ClusterOutput(fifth)
