# Grasshopper definition Async Test-Continue.gh (Grasshopper 1.0.7)
# plug-ins: Telepathy, pOd

box = CenterBox(Base=PlaneXY(0, 0, 0), X=1, Y=1, Z=1)
number_slider = Slider(69, range=0..100)
pick_vef = POd_PickVEF(Geometry=box, ButtonOn=False, EdgeOn=False, FaceOn=False, IndexSets="1", VertexOn=True)  # -> Index, GeometryPart
fifth = CSharpScript(x=pick_vef.Index)  # -> out, A
# ---------- fifth: C# usings ----------
using System.Threading;
# ---------- fifth: C# ----------
    Thread.Sleep(5000);
    A = x;
# ---------- end fifth ----------
test = RemoteSender(fifth.A)
test_2 = RemoteReceiver(test)
panel = Panel(test_2)
