# Grasshopper definition Async Test-IndexOutOfRange.gh (Grasshopper 1.0.7)

series = Series(Start=0, Step=1, Count=20)
series_2 = Series(Start=0, Step=1, Count=Slider(8, range=5..10))
pt = ConstructPoint(XCoordinate=graft(series), YCoordinate=series_2, ZCoordinate=0)  # -> simplify(Point)

tstat = TreeStatistics(Tree=pt)  # -> Paths, Length, Count
series_3 = Series(Start=0, Step=1, Count=tstat.Count)  # -> graft(Series)
series_4 = Series(Start=0, Step=1, Count=tstat.Length)
pt_2 = ConstructPoint(XCoordinate=series_3, YCoordinate=series_4, ZCoordinate=0)  # -> simplify(graft(Point))

item = ListItem(List=tstat.Length, Index=0, Wrap=True)
pt_3 = ConstructPoint(XCoordinate=-1, YCoordinate=0, ZCoordinate=0)
pt_4 = ConstructPoint(XCoordinate=1, YCoordinate=0, ZCoordinate=0)
pt_5 = ConstructPoint(XCoordinate=0, YCoordinate=1, ZCoordinate=0)
pt_6 = ConstructPoint(XCoordinate=0, YCoordinate=-1, ZCoordinate=0)
addition = Addition(A=pt_2, B=pt_3)
addition_2 = Addition(A=pt_2, B=pt_4)
addition_3 = Addition(A=pt_2, B=pt_5)
addition_4 = Addition(A=pt_2, B=pt_6)
merge = Merge(Data1=addition, Data2=addition_2, Data3=addition_3, Data4=addition_4)
pdecon = Deconstruct(Point=merge)  # -> XComponent, YComponent, ZComponent
larger = LargerThan(FirstNumber=pdecon.YComponent, SecondNumber=0)  # -> LargerThan, OrEqualTo
larger_2 = LargerThan(FirstNumber=pdecon.XComponent, SecondNumber=0)  # -> LargerThan, OrEqualTo
smaller = SmallerThan(FirstNumber=pdecon.YComponent, SecondNumber=item)  # -> SmallerThan, OrEqualTo
smaller_2 = SmallerThan(FirstNumber=pdecon.XComponent, SecondNumber=tstat.Count)  # -> SmallerThan, OrEqualTo
and = GateAnd(A=larger_2.OrEqualTo, B=smaller_2.SmallerThan, C=larger.OrEqualTo, D=smaller.SmallerThan)
cull = CullPattern(List=merge, CullPattern=and)
pdecon_2 = Deconstruct(Point=pt_2)  # -> XComponent, YComponent, ZComponent
path = DataPath(tstat.Paths)
pdecon_3 = Deconstruct(Point=cull)  # -> XComponent, YComponent, ZComponent
item_2 = ListItem(List=path, Index=pdecon_2.XComponent, Wrap=True)
item_3 = ListItem(List=path, Index=pdecon_3.XComponent, Wrap=True)
item_4 = TreeItem(Tree=pt, Path=item_3, Index=pdecon_3.YComponent, Wrap=True)
item_5 = TreeItem(Tree=pt, Path=item_2, Index=pdecon_2.YComponent, Wrap=True)
bang = ExplodeTree(Data=item_4)  # -> Branch0, Branch1
bang_2 = ExplodeTree(Data=item_5)  # -> Branch0, Branch1
