# Grasshopper definition Async Test-MultiTask.gh (Grasshopper 1.0.7)

series = Series(Start=0, Step=Slider(10, range=0..100), Count=10)
first = CSharpScript(y=series)  # -> out, A
# ---------- first: C# usings ----------
using System.Threading;
# ---------- first: C# ----------
    Thread.Sleep(1000);
    A = new Point3d(Iteration, Iteration, Iteration);
    //this.Component.Message = this.Component.Phase.ToString();
# ---------- end first ----------
sixth = CSharpScript()  # -> out, A
# ---------- sixth: C# ----------
    Thread.Sleep(1000);
    //this.Component.Message = this.Component.Phase.ToString();
# ---------- end sixth ----------
pt = Point(first.A)
second = CSharpScript(x=first.A)  # -> out, A; same code as sixth
panel = Panel(sixth.A)
fifth = CSharpScript(x=second.A, y=sixth.A)  # -> out, A; same code as sixth
third = CSharpScript(x=first.A, y=second.A)  # -> out, A; same code as sixth
forth = CSharpScript(x=fifth.A, y=third.A)  # -> out, A; same code as sixth
