# Grasshopper definition Async Test-ProcessBar.gh (Grasshopper 1.0.7)

series = Series(Start=0, Step=1, Count=10)
first = CSharpScript(x=series)  # -> out, A
# ---------- first: C# usings ----------
using System.Threading;
# ---------- first: C# ----------
    Thread.Sleep(100);
    //this.Component.Message = this.Component.Phase.ToString();
# ---------- end first ----------
