# Grasshopper definition Async Test-Solution.gh (Grasshopper 1.0.7)

series = Series(Start=0, Step=1, Count=10)
c_script = CSharpScript(x=series)  # -> out, A; inputs x: list
# ---------- c_script: C# ----------
    System.Windows.Forms.MessageBox.Show("Hello");
# ---------- end c_script ----------
series_2 = Series(Start=series, Step=1, Count=10)
series_3 = Series(Start=series_2, Step=Slider(54, range=0..100), Count=10)
